# Grasshopper definition v1.gh (Grasshopper 1.0.7)
# plug-ins: horsterCameraControl

timer = Timer(TimerInterval=1, Target=getcamera)  # disabled

crv = Curve(<curve referenced from the Rhino model>)
eval = EvaluateCurve(Curve=reparameterize(crv), Parameter=Slider(1, range=0..1))  # -> Point, Tangent, Angle

number_slider = Slider(0, range=0..100)
animcamera = AnimateCamera(SaveCameraState=False, Reset=False)
getcamera = GetCamera(GetCamera=Toggle(True))  # -> Location, Target, LensLength, UpDirection
geo = Geometry(<brep referenced from the Rhino model>)
panel = Panel(getcamera.Target)
panel_2 = Panel(getcamera.LensLength)
location = Panel(getcamera.Location)
panel_3 = Panel(getcamera.UpDirection)
mesh = Mesh(geo)
pt = ConstructPoint(XCoordinate=number_slider, YCoordinate=number_slider, ZCoordinate=number_slider)
demesh = DeconstructMesh(Mesh=mesh)  # -> Vertices, Faces, Colours, Normals
setcam = SetCamera(CameraLocation=eval.Point, TargetLocation=pt, LensLength=Slider(60, range=0..100), Activate=Toggle(True))
subtraction = Subtraction(A=panel, B=location)
line = LineSDL(Start=location, Direction=subtraction, Length=Slider(500, range=0..1000))

pl = PlaneNormal(Origin=location, ZAxis=subtraction)
Z = UnitZ(Factor=1)
deplane = DeconstructPlane(Plane=pl)  # -> Origin, XAxis, YAxis, ZAxis
extr = Extrude(Base=line, Direction=Z)
sec = BrepPlane(Brep=extr, Plane=pl)  # -> Curves, Points
pl_2 = ConstructPlane(Origin=deplane.Origin, XAxis=sec.Curves, YAxis=eval.Tangent)

deplane_2 = DeconstructPlane(Plane=pl_2)  # -> Origin, XAxis, YAxis, ZAxis
pl_3 = PlaneNormal(Origin=deplane_2.Origin, ZAxis=deplane_2.XAxis)
number_slider_2 = Slider(11, range=0..100)
pl_4 = PlaneNormal(Origin=deplane_2.Origin, ZAxis=deplane_2.YAxis)
python = GhPythonScript(
    max_angle_u=Slider(10, range=0..10),
    max_angle_v=Slider(10, range=0..10),
    num_pix_u=Slider(20, range=0..100),
    num_pix_v=Slider(11, range=0..100))  # -> out, u_parameters, v_parameters; inputs num_pix_u: Int32, num_pix_v: Int32
# ---------- python: Python ----------
__author__ = "ellin"
__version__ = "2020.10.09"

import rhinoscriptsyntax as rs

u_parameters = []
v_parameters = []

# define one angle increment
u_stepsize = max_angle_u*2/num_pix_u
v_stepsize = max_angle_v*2/num_pix_v

current_angle_u = -max_angle_u
# add all the angel increments
for i in range(num_pix_u+1):
    
    u_parameters.append(current_angle_u)
    current_angle_u += u_stepsize
    
current_angle_v = -max_angle_v
# add all the angel increments
for i in range(num_pix_v+1):
    
    v_parameters.append(current_angle_v)
    current_angle_v += v_stepsize
# ---------- end python ----------
panel_4 = Panel(python.u_parameters)
panel_5 = Panel(python.v_parameters)
panel_6 = Panel("""-5
-4
-3
-2
-1
0
1
2
3
4
5""")

rad = Radians(Degrees=panel_6)
rotate = Rotate(Geometry=line, Angle=rad, Plane=pl_4)  # -> Geometry, Transform
end = EndPoints(Curve=rotate.Geometry)  # -> Start, End

rad_2 = Radians(Degrees=panel_6)
rotate_2 = Rotate(Geometry=graft(rotate.Geometry), Angle=rad_2, Plane=pl_3)  # -> Geometry, Transform
end_2 = EndPoints(Curve=rotate_2.Geometry)  # -> Start, End

meshray = MeshRay(Mesh=mesh, Point=location, Direction=flatten(rotate_2.Geometry))  # -> Point, Hit
panel_7 = Panel(meshray.Hit)
