# Grasshopper definition v4.gh (Grasshopper 1.0.7)
# plug-ins: Pufferfish, horsterCameraControl

timer = Timer(TimerInterval=1, Target=getcamera)  # disabled

crv = Curve(<curve referenced from the Rhino model>)
eval = EvaluateCurve(Curve=reparameterize(crv), Parameter=Slider(0.4, range=0..1))  # -> Point, Tangent, Angle

number_slider = Slider(23, range=0..100)
getcamera = GetCamera(GetCamera=Toggle(True))  # -> Location, Target, LensLength, UpDirection
animcamera = AnimateCamera(SaveCameraState=False, Reset=False)
geo = Geometry(<brep referenced from the Rhino model>)
geo_2 = Geometry([<brep referenced from the Rhino model>, <mesh referenced from the Rhino model> x7])
custom_mesh_settings = SettingsCustom(
    StitchSeams=True,
    SimplePlanes=False,
    Refine=True,
    MinCount=Slider(40, range=0..1000),
    MaxCount=400,
    AspectRatio=20,
    MaxDistance=0,
    MaxAngle=20,
    MinEdge=0,
    MaxEdge=0)
mjoin = MeshJoin(Meshes=geo_2)
redumsh = ReduceMesh(Mesh=mjoin, FaceCount=Slider(200, range=0..1000), Accuracy=1, FaceType=0, Distort=True, Normalize=False)  # -> Reduced, CountDifference
panel = Panel(getcamera.Target)
panel_2 = Panel(getcamera.LensLength)
location = Panel(getcamera.Location)
panel_3 = Panel(getcamera.UpDirection)
pt = ConstructPoint(XCoordinate=number_slider, YCoordinate=number_slider, ZCoordinate=number_slider)
mesh = Mesh(mjoin)
mesh_2 = MeshBrep(Brep=geo, Settings=custom_mesh_settings)
vec = Vector(getcamera.Target)
custom_mesh_settings_2 = SettingsCustom(
    StitchSeams=True,
    SimplePlanes=False,
    Refine=True,
    MinCount=Slider(40, range=0..1000),
    MaxCount=400,
    AspectRatio=20,
    MaxDistance=0,
    MaxAngle=20,
    MinEdge=0,
    MaxEdge=0)
vec_2 = Vector(getcamera.Location)
setcam = SetCamera(CameraLocation=eval.Point, TargetLocation=pt, LensLength=Slider(60, range=0..100), Activate=Toggle(True))
mesh_3 = MeshBrep(Brep=geo, Settings=custom_mesh_settings_2)
subtraction = Subtraction(A=vec, B=vec_2)
line = LineSDL(Start=vec_2, Direction=subtraction, Length=Slider(5000, range=0..10000))

pl = PlaneNormal(Origin=vec_2, ZAxis=subtraction)
Z = UnitZ(Factor=1)
deplane = DeconstructPlane(Plane=pl)  # -> Origin, XAxis, YAxis, ZAxis
extr = Extrude(Base=line, Direction=Z)
sec = BrepPlane(Brep=extr, Plane=pl)  # -> Curves, Points
pl_2 = ConstructPlane(Origin=deplane.Origin, XAxis=sec.Curves, YAxis=eval.Tangent)

deplane_2 = DeconstructPlane(Plane=pl_2)  # -> Origin, XAxis, YAxis, ZAxis
pl_3 = PlaneNormal(Origin=deplane_2.Origin, ZAxis=deplane_2.XAxis)
number_slider_2 = Slider(10, range=0..10)
pl_4 = PlaneNormal(Origin=deplane_2.Origin, ZAxis=deplane_2.YAxis)
python = GhPythonScript(
    max_angle_u=Slider(10, range=0..100),
    max_angle_v=Slider(10, range=0..100),
    num_pix_u=Slider(20, range=0..256),
    num_pix_v=Slider(20, range=0..256))  # -> out, u_parameters, v_parameters; inputs num_pix_u: Int32, num_pix_v: Int32
# ---------- python: Python ----------
__author__ = "ellin"
__version__ = "2020.10.09"

import rhinoscriptsyntax as rs

u_parameters = []
v_parameters = []

# define one angle increment
u_stepsize = max_angle_u*2/num_pix_u
v_stepsize = max_angle_v*2/num_pix_v

current_angle_u = -max_angle_u
# add all the angel increments
for i in range(num_pix_u+1):
    
    u_parameters.append(current_angle_u)
    current_angle_u += u_stepsize
    
current_angle_v = -max_angle_v
# add all the angel increments
for i in range(num_pix_v+1):
    
    v_parameters.append(current_angle_v)
    current_angle_v += v_stepsize
# ---------- end python ----------
panel_4 = Panel(python.u_parameters)
panel_5 = Panel(python.v_parameters)
panel_6 = Panel("""-5
-4
-3
-2
-1
0
1
2
3
4
5""")
demesh = DeconstructMesh(Mesh=mesh_2)  # -> Vertices, Faces, Colours, Normals

rad = Radians(Degrees=panel_5)
rotate = Rotate(Geometry=line, Angle=rad, Plane=pl_4)  # -> Geometry, Transform
end = EndPoints(Curve=rotate.Geometry)  # -> Start, End

rad_2 = Radians(Degrees=panel_4)
rotate_2 = Rotate(Geometry=graft(rotate.Geometry), Angle=rad_2, Plane=pl_3)  # -> Geometry, Transform
end_2 = EndPoints(Curve=rotate_2.Geometry)  # -> Start, End

panel_7 = Panel(demesh.Faces)
pt_2 = Point(demesh.Vertices)
meshray = MeshRay(Mesh=mesh_2, Point=vec_2, Direction=flatten(rotate_2.Geometry))  # -> Point, Hit
dist = Distance(PointA=graft(meshray.Point), PointB=pt_2)
panel_8 = Panel(meshray.Hit)
sort = SortList(Keys=dist, ValuesA=pt_2)  # -> Keys, ValuesA
item = ListItem(List=sort.ValuesA, Index=0, Wrap=True)
ln = Line(StartPoint=graft(meshray.Point), EndPoint=item)  # -> simplify(Line)
panel_9 = Panel(ln)
