# Grasshopper definition v5.gh (Grasshopper 1.0.7)
# plug-ins: Pufferfish, horsterCameraControl

timer = Timer(TimerInterval=1, Target=getcamera)  # disabled
number_slider = Slider(5000, range=0..10000)  # disabled

crv = Curve(<curve referenced from the Rhino model>)
eval = EvaluateCurve(Curve=reparameterize(crv), Parameter=Slider(0.4, range=0..1))  # -> Point, Tangent, Angle

number_slider_2 = Slider(23, range=0..100)
getcamera = GetCamera(GetCamera=Toggle(True))  # -> Location, Target, LensLength, UpDirection
animcamera = AnimateCamera(SaveCameraState=False, Reset=False)
geo = Geometry(<brep referenced from the Rhino model>)
geo_2 = Geometry([<brep referenced from the Rhino model>, <mesh referenced from the Rhino model> x7])  # disabled
custom_mesh_settings = SettingsCustom(
    StitchSeams=True,
    SimplePlanes=False,
    Refine=True,
    MinCount=Slider(40, range=0..1000),
    MaxCount=400,
    AspectRatio=20,
    MaxDistance=0,
    MaxAngle=20,
    MinEdge=0,
    MaxEdge=0)
mjoin = MeshJoin(Meshes=geo_2)  # disabled
redumsh = ReduceMesh(Mesh=mjoin, FaceCount=number_slider, Accuracy=1, FaceType=0, Distort=True, Normalize=False)  # -> Reduced, CountDifference; disabled
panel = Panel(getcamera.Target)
panel_2 = Panel(getcamera.LensLength)
location = Panel(getcamera.Location)
panel_3 = Panel(getcamera.UpDirection)
pt = ConstructPoint(XCoordinate=number_slider_2, YCoordinate=number_slider_2, ZCoordinate=number_slider_2)
mesh = Mesh(mjoin)  # disabled
geo_3 = Geometry(redumsh.Reduced)  # disabled
mesh_2 = MeshBrep(Brep=geo, Settings=custom_mesh_settings)
vec = Vector(getcamera.Target)
custom_mesh_settings_2 = SettingsCustom(
    StitchSeams=True,
    SimplePlanes=False,
    Refine=True,
    MinCount=Slider(40, range=0..1000),
    MaxCount=400,
    AspectRatio=20,
    MaxDistance=0,
    MaxAngle=20,
    MinEdge=0,
    MaxEdge=0)
vec_2 = Vector(getcamera.Location)
setcam = SetCamera(CameraLocation=eval.Point, TargetLocation=pt, LensLength=Slider(60, range=0..100), Activate=Toggle(True))
mesh_3 = MeshBrep(Brep=geo, Settings=custom_mesh_settings_2)
subtraction = Subtraction(A=vec, B=vec_2)
line = LineSDL(Start=vec_2, Direction=subtraction, Length=Slider(5000, range=0..10000))

pl = PlaneNormal(Origin=vec_2, ZAxis=subtraction)
Z = UnitZ(Factor=1)
deplane = DeconstructPlane(Plane=pl)  # -> Origin, XAxis, YAxis, ZAxis
extr = Extrude(Base=line, Direction=Z)
sec = BrepPlane(Brep=extr, Plane=pl)  # -> Curves, Points
pl_2 = ConstructPlane(Origin=deplane.Origin, XAxis=sec.Curves, YAxis=eval.Tangent)

deplane_2 = DeconstructPlane(Plane=pl_2)  # -> Origin, XAxis, YAxis, ZAxis
pl_3 = PlaneNormal(Origin=deplane_2.Origin, ZAxis=deplane_2.XAxis)
number_slider_3 = Slider(10, range=0..10)
pl_4 = PlaneNormal(Origin=deplane_2.Origin, ZAxis=deplane_2.YAxis)
python = GhPythonScript(
    max_angle_u=Slider(10, range=0..100),
    max_angle_v=Slider(10, range=0..100),
    num_pix_u=Slider(20, range=0..256),
    num_pix_v=Slider(20, range=0..256))  # -> out, u_parameters, v_parameters; inputs num_pix_u: Int32, num_pix_v: Int32
# ---------- python: Python ----------
__author__ = "ellin"
__version__ = "2020.10.09"

import rhinoscriptsyntax as rs

u_parameters = []
v_parameters = []

# define one angle increment
u_stepsize = max_angle_u*2/num_pix_u
v_stepsize = max_angle_v*2/num_pix_v

current_angle_u = -max_angle_u
# add all the angel increments
for i in range(num_pix_u+1):
    
    u_parameters.append(current_angle_u)
    current_angle_u += u_stepsize
    
current_angle_v = -max_angle_v
# add all the angel increments
for i in range(num_pix_v+1):
    
    v_parameters.append(current_angle_v)
    current_angle_v += v_stepsize
# ---------- end python ----------
panel_4 = Panel(python.u_parameters)
panel_5 = Panel(python.v_parameters)
panel_6 = Panel("""-5
-4
-3
-2
-1
0
1
2
3
4
5""")

rad = Radians(Degrees=panel_5)
rotate = Rotate(Geometry=line, Angle=rad, Plane=pl_4)  # -> Geometry, Transform
end = EndPoints(Curve=rotate.Geometry)  # -> Start, End

rad_2 = Radians(Degrees=panel_4)
rotate_2 = Rotate(Geometry=graft(rotate.Geometry), Angle=rad_2, Plane=pl_3)  # -> Geometry, Transform
end_2 = EndPoints(Curve=rotate_2.Geometry)  # -> Start, End

demesh = DeconstructMesh(Mesh=mesh_2)  # -> Vertices, Faces, Colours, Normals
# TODO:
# # sorting logic must be changed
# # every point must find it's closest mesh/ray intersection event
# # if this is closer than some value x, then give
# it the label of that ray (is that necessary?)
# --> yes, to not lable the back side of the mesh!
pt_meshvertices = Point(demesh.Vertices)
python_2 = GhPythonScript(list_in=pt_meshvertices)  # -> out, list_of_indizes; inputs list_in: list
# ---------- python_2: Python ----------
__author__ = "ellin"
__version__ = "2020.10.09"

import rhinoscriptsyntax as rs

res = []

for i in range(len(list_in)):
    res.append(i)

list_of_indizes = res
# ---------- end python_2 ----------
meshray = MeshRay(Mesh=mesh_2, Point=vec_2, Direction=flatten(rotate_2.Geometry))  # -> Point, Hit
panel_7 = Panel(demesh.Faces)
panel_8 = Panel(meshray.Hit)
panel_9 = Panel(python_2.list_of_indizes)
pt_intersec_events = Point(meshray.Point)
python_3 = GhPythonScript(x=meshray.Hit)  # -> out, a; inputs x: list
# ---------- python_3: Python ----------
__author__ = "ellin"
__version__ = "2020.10.09"

import rhinoscriptsyntax as rs

print(x.count(True))
print(x.count(False))

print(x.count(True)+x.count(False))
# ---------- end python_3 ----------
dist = Distance(PointA=graft(pt_intersec_events), PointB=pt_meshvertices)

# ----
# TODO
# # Do the opposite:
# FIND A CLOSEST INTERSECT FOR EACH POINT
# # sort the point indexes along with the point coordinates
sort = SortList(Keys=dist, ValuesA=pt_meshvertices, ValuesB=panel_9)  # -> Keys, ValuesA, ValuesB

item = ListItem(List=sort.ValuesA, Index=0, Wrap=True)  # -> simplify(Item)
ln = Line(StartPoint=graft(pt_intersec_events), EndPoint=item)  # -> simplify(Line)
item_2 = ListItem(List=sort.ValuesB, Index=0, Wrap=True)  # -> simplify(Item)
panel_10 = Panel(ln)
the_intersections_if_exists_ordered_by_r = Panel(meshray.Point)  # "The intersections (if exists) ordered by ray order"
panel_11 = Panel(item)
point_index_from_mesh = Panel(item_2)
