# Grasshopper definition v9.gh (Grasshopper 1.0.7)
# plug-ins: Pufferfish, horsterCameraControl

timer = Timer(TimerInterval=1, Target=getcamera_2)  # disabled
getcamera = BooleanToggle(True)
number_slider = Slider(5000, range=0..10000)  # disabled

crv = Curve(<curve referenced from the Rhino model>)
eval = EvaluateCurve(Curve=reparameterize(crv), Parameter=Slider(0.4, range=0..1))  # -> Point, Tangent, Angle

number_slider_2 = Slider(0, range=0..100)
getcamera_2 = GetCamera(GetCamera=getcamera)  # -> Location, Target, LensLength, UpDirection
animcamera = AnimateCamera(SaveCameraState=False, Reset=False)
geo = Geometry(<brep referenced from the Rhino model>)
geo_2 = Geometry([<brep referenced from the Rhino model>, <mesh referenced from the Rhino model> x7])  # disabled
custom_mesh_settings = SettingsCustom(
    StitchSeams=True,
    SimplePlanes=False,
    Refine=True,
    MinCount=Slider(50, range=0..1000),
    MaxCount=400,
    AspectRatio=20,
    MaxDistance=0,
    MaxAngle=20,
    MinEdge=0,
    MaxEdge=0)
mjoin = MeshJoin(Meshes=geo_2)  # disabled
redumsh = ReduceMesh(Mesh=mjoin, FaceCount=number_slider, Accuracy=1, FaceType=0, Distort=True, Normalize=False)  # -> Reduced, CountDifference; disabled
panel = Panel(getcamera_2.Target)
panel_2 = Panel(getcamera_2.LensLength)
location = Panel(getcamera_2.Location)
panel_3 = Panel(getcamera_2.UpDirection)
pt = ConstructPoint(XCoordinate=number_slider_2, YCoordinate=number_slider_2, ZCoordinate=number_slider_2)
mesh = Mesh(mjoin)  # disabled
geo_3 = Geometry(redumsh.Reduced)  # disabled
mesh_2 = MeshBrep(Brep=geo, Settings=custom_mesh_settings)
setcamera = BooleanToggle(True)
vec = Vector(getcamera_2.Target)
custom_mesh_settings_2 = SettingsCustom(
    StitchSeams=True,
    SimplePlanes=False,
    Refine=True,
    MinCount=Slider(40, range=0..1000),
    MaxCount=400,
    AspectRatio=20,
    MaxDistance=0,
    MaxAngle=20,
    MinEdge=0,
    MaxEdge=0)
vec_2 = Vector(getcamera_2.Location)
setcam = SetCamera(CameraLocation=eval.Point, TargetLocation=pt, LensLength=Slider(60, range=0..100), Activate=setcamera)
mesh_3 = MeshBrep(Brep=geo, Settings=custom_mesh_settings_2)
subtraction = Subtraction(A=vec, B=vec_2)
line = LineSDL(Start=vec_2, Direction=subtraction, Length=Slider(5000, range=0..10000))

pl = PlaneNormal(Origin=vec_2, ZAxis=subtraction)
Z = UnitZ(Factor=1)
deplane = DeconstructPlane(Plane=pl)  # -> Origin, XAxis, YAxis, ZAxis
extr = Extrude(Base=line, Direction=Z)
sec = BrepPlane(Brep=extr, Plane=pl)  # -> Curves, Points
pl_2 = ConstructPlane(Origin=deplane.Origin, XAxis=sec.Curves, YAxis=eval.Tangent)

deplane_2 = DeconstructPlane(Plane=pl_2)  # -> Origin, XAxis, YAxis, ZAxis
pl_3 = PlaneNormal(Origin=deplane_2.Origin, ZAxis=deplane_2.XAxis)
number_slider_3 = Slider(10, range=0..10)
pl_4 = PlaneNormal(Origin=deplane_2.Origin, ZAxis=deplane_2.YAxis)
python = GhPythonScript(
    max_angle_u=Slider(10, range=0..100),
    max_angle_v=Slider(10, range=0..100),
    num_pix_u=Slider(20, range=0..256),
    num_pix_v=Slider(20, range=0..256))  # -> out, u_parameters, v_parameters; inputs num_pix_u: Int32, num_pix_v: Int32
# ---------- python: Python ----------
__author__ = "ellin"
__version__ = "2020.10.09"

import rhinoscriptsyntax as rs

u_parameters = []
v_parameters = []

# define one angle increment
u_stepsize = max_angle_u*2/num_pix_u
v_stepsize = max_angle_v*2/num_pix_v

current_angle_u = -max_angle_u
# add all the angel increments
for i in range(num_pix_u+1):
    
    u_parameters.append(current_angle_u)
    current_angle_u += u_stepsize
    
current_angle_v = -max_angle_v
# add all the angel increments
for i in range(num_pix_v+1):
    
    v_parameters.append(current_angle_v)
    current_angle_v += v_stepsize
# ---------- end python ----------
panel_4 = Panel(python.u_parameters)
panel_5 = Panel(python.v_parameters)
panel_6 = Panel("""-5
-4
-3
-2
-1
0
1
2
3
4
5""")
demesh = DeconstructMesh(Mesh=mesh_2)  # -> Vertices, Faces, Colours, Normals

rad = Radians(Degrees=panel_5)
rotate = Rotate(Geometry=line, Angle=rad, Plane=pl_4)  # -> Geometry, Transform
end = EndPoints(Curve=rotate.Geometry)  # -> Start, End

rad_2 = Radians(Degrees=panel_4)
rotate_2 = Rotate(Geometry=graft(rotate.Geometry), Angle=rad_2, Plane=pl_3)  # -> flatten(Geometry), Transform
end_2 = EndPoints(Curve=rotate_2.Geometry)  # -> Start, End

pt_meshvertices = Point(demesh.Vertices)
listdexs = ListIndices()

# ----
# TUNING PARAM
number_slider_4 = Slider(10, range=0..20)

meshray = MeshRay(Mesh=mesh_2, Point=vec_2, Direction=rotate_2.Geometry)  # -> Point, Hit

# ---- group: Dispatch interesction events by true/false (x output of previous component contains a lot of null values!)
dispatch = Dispatch(List=meshray.Point, DispatchPattern=meshray.Hit)  # -> ListA, ListB
pt_2 = Point(dispatch.ListA)

# ----
pt_intersec_events = Point(pt_2)
cp = ClosestPoint(Point=graft(pt_meshvertices), Cloud=pt_intersec_events)  # -> flatten(ClosestPoint), flatten(CPIndex), Distance
panel_7 = Panel(meshray.Hit)
panel_8 = Panel(cp.CPIndex)
dist = Distance(PointA=cp.ClosestPoint, PointB=pt_meshvertices)

# ---- group: link mesh vertex and nearest intersection event
ln = Line(StartPoint=cp.ClosestPoint, EndPoint=pt_meshvertices)

# ----
# TODO:
# # sorting logic must be changed
# # every point must find it's closest mesh/ray intersection event
# # if this is closer than some value x, then give
# it the label of that ray (is that necessary?)
# --> yes, to not lable the back side of the mesh!
larger = LargerThan(FirstNumber=dist, SecondNumber=number_slider_4)  # -> LargerThan, OrEqualTo
python_2 = GhPythonScript(rays_list=rotate_2.Geometry, border_index=Slider(250, range=0..1000))  # -> out, colors_list; inputs rays_list: list, border_index: Int32
# ---------- python_2: Python ----------
__author__ = "ellin"
__version__ = "2020.10.09"

import rhinoscriptsyntax as rs

colors_list = []
red = "255,0,0"
for i in range(len(rays_list) - border_index):
    colors_list.append(red)

blue = "0,0,255"
for i in range(border_index):
    colors_list.append(blue)
# ---------- end python_2 ----------
dispatch_2 = Dispatch(List=pt_meshvertices, DispatchPattern=larger.LargerThan)  # -> ListA, ListB

# ---- group: filter out vertices that are to far from intersection event
dispatch_3 = Dispatch(List=ln, DispatchPattern=larger.LargerThan)  # -> ListA, ListB
crv_2 = Curve(dispatch_3.ListB)

# ----
panel_9 = Panel(python_2.colors_list)

# ---- group: dispatch colors by intersectionevent true/false
dispatch_4 = Dispatch(List=panel_9, DispatchPattern=meshray.Hit)  # -> ListA, ListB
panel_10 = Panel(dispatch_4.ListB)

# ---- group: match intersection events and colors
panel_11 = Panel(dispatch_4.ListA)
preview = CustomPreview(Geometry=pt_2, Material=panel_11)

# ----
item = ListItem(List=panel_11, Index=cp.CPIndex, Wrap=True)
pt_3 = Point(dispatch_2.ListB)
python_3 = GhPythonScript(x=meshray.Hit)  # -> out, a; inputs x: list
# ---------- python_3: Python ----------
__author__ = "ellin"
__version__ = "2020.10.09"

import rhinoscriptsyntax as rs

print(x.count(True))
print(x.count(False))

print(x.count(True)+x.count(False))
# ---------- end python_3 ----------
preview_2 = CustomPreview(Geometry=rotate_2.Geometry, Material=panel_9)
preview_3 = CustomPreview(Geometry=end_2.End, Material=panel_9)

# ---- group: This shows the solution
dispatch_5 = Dispatch(List=item, DispatchPattern=larger.LargerThan)  # -> ListA, ListB
preview_4 = CustomPreview(Geometry=pt_3, Material=dispatch_5.ListB)

# ---- group: link color and intersection event
preview_5 = CustomPreview(Geometry=pt_intersec_events, Material=panel_11)
